vi "TemperatureConverter.gvi"   [LabVIEW NXG 2.0.0]
panel controls:
  "Input Temperature": f64
  "Temperature Unit": enum{"Fahrenheit", "Celsius"} = "Fahrenheit"
panel indicators:
  "Output Temperature": f64
  "Units": string
diagram:
  Is Equal To 0(x=$"Temperature Unit") -> w1
  case (w1) {
    frame False, Default {
      # Celsius to Fahrenheit Converter
      # MISSING: Conversion Equation
      w2 = default
      w3 = "Fahrenheit"
    }
    frame True {
      # Fahrenheit to Celsius Converter
      # MISSING: Correct Units output
      Subtract(x=$"Input Temperature", y=32) -> w4
      Multiply(w4, 5) -> w5
      Divide(x=w5, y=9) -> w2
      w3 = default
    }
  }
  $"Output Temperature" <- w2
  $Units <- w3
